# Grasshopper definition ceramic_lid.gh (Grasshopper 1.0.7)

# En este caso se está escalando
# con un factor de 0.9 para que
# encaje con la maceta
geo = Geometry([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])
geo_2 = Geometry([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])

geo_3 = Geometry([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])
panel = Panel("6mm")

scale = Scale(Geometry=geo_3, Center=Point(0, 0, 0), Factor=Slider(0.9, range=0..1))  # -> Geometry, Transform

# ----
# 1_ Vincular aquí la geometría a imprimir
geo_4 = Geometry(scale.Geometry)

# ----
# 2.1_ Con este valor se sube o baja
# la pieza para que la altura de la primera
# capa sea la adecuada
number_slider = Slider(6.5, range=0..100)

# ----
# 2_ Encajar la pieza en el centro
# del plato de impresión
number_slider_2 = Slider(220, range=0..1000)

# ----
# Plato impresora (aprox)
pt = Point(Point(0, 0, 0))
pt_2 = Point(Point(410, 410, 0))
rec_2pt = Rectangle2Pt(Plane=PlaneXY(0, 0, 0), PointA=pt, PointB=pt_2, Radius=0)  # -> Rectangle, Length

item = ListItem(List=geo_4, Index=0, Wrap=True)
bbox = BoundingBox(Content=item, Plane=PlaneXY(0, 0, 0))  # -> Box, Box_2
pt_3 = ConstructPoint(XCoordinate=number_slider_2, YCoordinate=Slider(200, range=0..1000), ZCoordinate=number_slider)
volume = Volume(Geometry=bbox.Box)  # -> Volume, Centroid
vec2pt = Vector2Pt(PointA=volume.Centroid, PointB=pt_3, Unitize=False)  # -> Vector, Length
move = Move(Geometry=geo_4, Motion=vec2pt.Vector)  # -> Geometry, Transform

# ----
# 3_ Parámetros básicos slicer
# En principio aquí no habría que
# tocar nada.
# Slicing distance = Altura de capa
number_slider_3 = Slider(1, range=1..3)
cluster = Cluster(
    ida_ida_y_vuelta_espiral=number_slider_3,
    geometry_input=move.Geometry,
    slicing_distance=Slider(1.8, range=0..10),
    tolerance_resolution=Slider(1, range=0..10))

geo_5 = Geometry(cluster)
pline = PolyLine(Vertices=geo_5, Closed=False)
merge = Merge(Data2=cluster)

# ----
# Velocidad
print_speed_f_mm_s = Slider(1200, range=0..3000)

# ----
# Extrusión
extruding_speed_e = Slider(2.2, range=0..50)

# ----
# Punto de inicio establecido en el (0,0,200)
pt_4 = Point(Point(0, 0, 200))

# ----
# 4_ Parámetros Velocidad (F) y Extrusión (E)
# Tampoco debería ser necesrio tocarlo
extruding_speed_e_2 = Slider(0, range=0..50)
cluster_2 = Cluster_2(points_extruding=merge, f_factor=print_speed_f_mm_s, e_factor=extruding_speed_e)
cluster_2_2 = Cluster_2_2(points_extruding=pt_4, f_factor=print_speed_f_mm_s, e_factor=extruding_speed_e_2)

wipe_point_elevation = Slider(1.5, range=0..10)  # disabled
toggle = BooleanToggle(True)  # disabled
number_slider_4 = Slider(120, range=0..1000)  # disabled
number_slider_5 = Slider(5, range=0..20)  # disabled
number_slider_6 = Slider(1, range=0..100)  # disabled
number_slider_7 = Slider(4, range=0..10)  # disabled
number_slider_8 = Slider(80, range=0..100)  # disabled
number_slider_9 = Slider(5, range=0..10)  # disabled
panel_2 = Panel(merge)  # disabled
txt = Text(cluster_2)
python = GhPythonScript(
    points=merge,
    max_angle=number_slider_8,
    min_angle=number_slider_4,
    resolution=number_slider_6,
    nozzle_diameter=number_slider_7,
    do_clean_path_end=toggle,
    wipe_distance=number_slider_5,
    wipe_point_elevation=wipe_point_elevation,
    z_hop=number_slider_9)  # -> out, simplify(filtered_points), simplify(printing_points); inputs points: list; disabled; same code as python
header = Panel(""";HEADER
;Start_gcode
G28;
G21                     ; Set to metric [change to G20 if you want Imperial]
G90                     ; Force coordinates to be absolute relative to the origin                     ; Home X/Y/Z axis
G92 E0                  ; Reset extruder to [0] zero end of cleaning                ; Reset extruder to [0] zero end of cleaning run
M83
M163 S0 P0.5
M163 S1 P0.5
M164 S0
M302 S0
T0
M117 Printing...""")
footer_travel_to_tower = Panel(""";FOOTER
; end_gcode
G91                             ; relative positioning
M107                            ; turn off layer fan
G90				; absolute positioning		
;ENDFOOTER""")
pt_5 = Point(python.printing_points)  # disabled
pline_2 = PolyLine(Vertices=pt_5, Closed=False)  # disabled
merge_2 = Merge(Data1=simplify(header), Data2=cluster_2_2, Data3=txt, Data4=footer_travel_to_tower)
clean = CleanTree(RemoveNulls=True, RemoveInvalid=True, RemoveEmpty=False, Tree=merge_2)
g_code_output = Text(clean)

# ----
# 5_ Seleccionar el panel
# Botón derecho
# Copy data only
# 6_ Crear un archivo de trexto y pegar el contenido.
# Modificar la extension del .txt a .gcode
# En pronterface, cargar dicho archivo
# (deben previsializarse entonces en Printerface
# las trayectorias de impresión).
panel_3 = Panel(g_code_output)

# ==== cluster Cluster
tolerance_resolution = ClusterInput()
slicing_distance = ClusterInput()
geometry_input = ClusterInput()
geometry_input_2 = Geometry(simplify(graft(geometry_input)))
tolerance_resolution_2 = Number(tolerance_resolution)
slicing_distance_2 = Number(slicing_distance)
branch = TreeBranch(Tree=geometry_input_2, Path=Slider(0, range=0..100), MaintainPaths=True)
item = ListItem(List=geometry_input_2, Index=0, Wrap=True)

# ----
# FUERZA AL CONTOUR A EMPEZAR JUSTO DONDE EMPIEZA LA PIEZA
bbox = BoundingBox(Content=geometry_input_2, Plane=PlaneXY(0, 0, 0))  # -> Box, Box_2
debrep = DeconstructBrep(Brep=bbox.Box)  # -> Faces, Edges, Vertices
item_2 = ListItem(List=debrep.Faces, Index="4", Wrap=True)
popgeo = PopulateGeometry(Geometry=item_2, Count="1", Seed=1)
xy = XYPlane(Origin=popgeo)  # -> simplify(Plane)

panel = Panel(item_2)
panel_2 = Panel(geometry_input_2)
Z = UnitZ(Factor=1)
contour = Contour(Shape=geometry_input_2, Point=xy, Direction=Z, Distance=slicing_distance_2)
pshift = ShiftPaths(Data=contour, Offset=-1)

# ----
# SELECCIÓN DEL MÉTODO
ida_ida_y_vuelta_espiral = ClusterInput()
subtraction = Subtraction(A=ida_ida_y_vuelta_espiral, B="1")
gate = StreamGate(Stream=pshift, Gate=subtraction)  # -> Target0, Target1, Target2

panel_3 = Panel(pshift)
relay = Relay()

# ----
# get the first layer to add the skirt to it
panel_4 = Panel("{0}")
split = SplitTree(Data=simplify(graft(relay)), Masks=flatten(panel_4))  # -> Positive, Negative
panel_5 = Panel("first layer")
geo = Geometry(split.Positive)

# ----
# SUBIDA CONTINUA: generacion de puntos
geo_2 = Geometry(gate.Target2)
crv_cp = CurveClosestPoint(Point="-1000,-1000,0", Curve=geo_2)  # -> Point, Parameter, Distance
seam = Seam(Curve=geo_2, Seam=crv_cp.Parameter)
divlength = DivideLength(Curve=seam, Length=tolerance_resolution_2)  # -> Points, Tangents, Parameters
simplify = SimplifyTree(Tree=divlength.Points, Front=False)
lng = ListLength(List=simplify)
division = Division(A=slicing_distance_2, B=lng)
series = Series(Start=0, Step=division, Count=lng)  # -> simplify(Series)
Z_2 = UnitZ(Factor=series)
move = Move(Geometry=simplify, Motion=Z_2)  # -> simplify(Geometry), Transform
pt = Point(simplify(move.Geometry))

# ----
# SUBIDA IDA Y VUELTA: Generacion de puntos
dispatch = Dispatch(List=gate.Target1, DispatchPattern=[True, False])  # -> simplify(graft(ListA)), simplify(graft(ListB))
flip = FlipCurve(Curve=dispatch.ListB)  # -> Curve, Flag
path_mapper = PathMapper(flip.Curve, source="{A}", target="{A*2+1}")
path_mapper_2 = PathMapper(dispatch.ListA, source="{A}", target="{A*2}")
flatten = FlattenTree(Tree=[path_mapper_2, path_mapper], Path="{0}")
divlength_2 = DivideLength(Curve=flatten, Length=tolerance_resolution_2)  # -> flatten(Points), Tangents, Parameters
pt_2 = Point(divlength_2.Points)

pline = PolyLine(Vertices=pt_2, Closed=False)
number_slider = Slider(5, range=0..1000)  # disabled
number_slider_2 = Slider(100, range=0..100)  # disabled
wipe_point_elevation = Slider(10, range=0..10)
Z_3 = UnitZ(Factor=number_slider)  # disabled
panel_6 = Panel("-1")  # disabled
viewer = ParamViewer()

bbox_2 = BoundingBox(Content=geometry_input_2, Plane=PlaneXY(0, 0, 0), UnionBox=True)  # -> Box, Box_2
debrep_2 = DeconstructBrep(Brep=bbox_2.Box)  # -> Faces, Edges, Vertices
item_3 = ListItem(List=debrep_2.Faces, Index="4", Wrap=True)
panel_7 = Panel("skirt")
debrep_3 = DeconstructBrep(Brep=item_3)  # -> Faces, Edges, Vertices
skirt_offset = Slider(26, range=0..100)
join = JoinCurves(Curves=debrep_3.Edges, Preserve=False)
panel_8 = Panel("skirt gen")

# ----
# SUBIDA IDA
flatten_2 = FlattenTree(Tree=gate.Target0, Path="{0}")

eval = EvaluateCurve(Curve=reparameterize(flatten_2), Parameter=Slider(0.5, range=0..1))  # -> Point, Tangent, Angle
pdecon = Deconstruct(Point=eval.Point)  # -> XComponent, YComponent, ZComponent
sort = SortList(Keys=pdecon.ZComponent, ValuesA=flatten_2)  # -> Keys, ValuesA

divlength_3 = DivideLength(Curve=sort.ValuesA, Length=tolerance_resolution_2)  # -> simplify(Points), Tangents, Parameters
pt_3 = Point(divlength_3.Points)

panel_9 = Panel("SKIRT")

offset = OffsetCurve(Curve=join, Distance=skirt_offset, Corners="2")  # -> flatten(Curve)

# ----
# get starting line and set skirt start
panel_10 = Panel("0")
item_4 = ListItem(List=geo, Index=panel_10, Wrap=True)
end = EndPoints(Curve=item_4)  # -> Start, End
crv_cp_2 = CurveClosestPoint(Point=end.Start, Curve=offset)  # -> Point, Parameter, Distance

addition = Addition(A=crv_cp_2.Parameter, B="0.01")
panel_11 = Panel("split skirt")
shatter = Shatter(Curve=offset, Parameters=[crv_cp_2.Parameter, addition])
len = Length(Curve=shatter)
sort_2 = SortList(Keys=len, ValuesA=shatter)  # -> Keys, ValuesA
item_5 = ListItem(List=sort_2.ValuesA, Index="-1", Wrap=True)

# ----
# Get the height of the first layer
midpt = CurveMiddle(Curve=geo)
xy_2 = XYPlane(Origin=midpt)
movetoplane = MoveToPlane(Geometry=item_5, Plane=xy_2, Above=True, Below=True)  # -> Geometry, Transform
panel_12 = Panel("EQUAL Z")

end_2 = EndPoints(Curve=geo)  # -> Start, End
end_3 = EndPoints(Curve=movetoplane.Geometry)  # -> Start, End
panel_13 = Panel("UNION SEGMENT")
ln = Line(StartPoint=end_3.End, EndPoint=end_2.Start)  # -> flatten(Line)

# ----
# join skirt and segment
merge = Merge(Data1=movetoplane.Geometry, Data2=ln)  # -> flatten(Result)
join_2 = JoinCurves(Curves=merge, Preserve=False)  # -> flatten(Curves)

divlength_4 = DivideLength(Curve=join_2, Length=tolerance_resolution_2)  # -> flatten(Points), Tangents, Parameters

merge_2 = Merge(Data1=pt_3, Data2=flatten(pt_2), Data3=flatten(pt), Data4=flatten(divlength_4.Points))

# ----
# cleans small segments
pline_2 = PolyLine(Vertices=merge_2, Closed=False)
pcol = PolylineCollapse(Polyline=pline_2, Tolerance=1)  # -> Polyline, Count
divlength_5 = DivideLength(Curve=pcol.Polyline, Length=tolerance_resolution_2)  # -> Points, Tangents, Parameters

pt_4 = Point(divlength_5.Points)
item_6 = ListItem(List=pt_4, Index=panel_6, Wrap=True)  # disabled
python = GhPythonScript(
    points=divlength_5.Points,
    max_angle=Slider(80, range=0..100),
    min_angle=Slider(120, range=0..1000),
    resolution=Slider(2, range=0..100),
    nozzle_diameter=Slider(4, range=0..10),
    do_clean_path_end=Toggle(True),
    wipe_distance=Slider(10, range=0..20),
    wipe_point_elevation=wipe_point_elevation,
    z_hop=Slider(5, range=0..10))  # -> out, simplify(filtered_points), simplify(printing_points); inputs points: list
# ---------- python: Python ----------
__author__ = "usuario"
__version__ = "2024.04.05"

import rhinoscriptsyntax as rs

filtered_points = []
toolpath_angle_at_last_point = 0

def filter_points (points, min_angle, resolution):
    toolpath_angle_at_last_point = 0
    
    for point_index in range(len(points)):
        #print(point_index)
        current_point = rs.PointCoordinates(points[point_index])
        # Nos aseguramos de añadir el primer y último punto, pero sin tenerlos en cuenta para el cálculo de ángulos
        if point_index == 0:
            filtered_points.append(current_point)
            #print('punto inicial añadido')
        elif point_index == len(points)-1:
            #print('punto final añadido')
            filtered_points.append(current_point)
            
        # cálculo de ángulos para los puntos intermedios y filtra por resolución
        else:
            previous_point = filtered_points[-1]
            next_point = rs.PointCoordinates(points[point_index +1])
            toolpath_angle_at_current_point = rs.Angle2((current_point, previous_point), (current_point, next_point))[0]
            
            if toolpath_angle_at_current_point < min_angle:
                filtered_points.append(current_point)
                toolpath_angle_at_last_point = toolpath_angle_at_current_point
                #Si se da esta condición, debemos revisar el último punto añadido, en caso de que no fuera añadido por ángulo, se elimina.
                #VOY A DESHABILITAR ESTO, YA QEU CUANDO SE AÑADEN VARIOS PUNTOS POR ÁNCGULO, SE DESCARTAN ERRONEAMENTE POR ESTAR MUY CERCA
                #LO QUE NECESITO QUE SI POR ANGULO DEBE SER AÑADIDO, SE AÑADA IGUALMENTE, PESE A QUEDAR MUY PEGADO
                #PERO CUANDO EL ANTERIOR NO HAYA SIDO AÑADIDO POR ÁNGULO Y LA DISTANCIA SEA DEMASIADO PEQUEÑA, SÍ QUE DEBE SER ELIMINADO
                
                if toolpath_angle_at_last_point and toolpath_angle_at_last_point < min_angle:
                    pass
                    
                else:
                    try:
                        # Medir la distancia respecto al punto anterior y eliminarlo si es necesario
                        if rs.Distance(previous_point, current_point) <= resolution:
                            del filtered_points[-2]
                    except IndexError:
                        # Manejar el caso en que el índice no exista en la lista
                        pass
                        
            #Y ahora los casos en los que no se añaden los puntos por ángulo
            elif rs.Distance(previous_point, current_point) >= resolution:
                filtered_points.append(current_point)
                toolpath_angle_at_last_point = toolpath_angle_at_current_point
    return filtered_points
    
def add_extra_points_for_resolutiom (points, resolution):
    printing_points = []
    #first, create a polyline with the points, explode it and subdivide the segments with the given resolution
    try:
        toolpath_polyline = rs.AddPolyline(points)
    except:
        return []
        
    segments = rs.ExplodeCurves(toolpath_polyline)
    
    for segment_index in range(len(segments)):
        current_segment = segments[segment_index]
        segment_division_number = rs.CurveLength(current_segment) // resolution
        
        if segment_division_number >= 1:
            points_from_division = rs.DivideCurve(current_segment, segment_division_number)
            
        else:
            points_from_division = []
            points_from_division.append(rs.CurveStartPoint(current_segment))
            points_from_division.append(rs.CurveEndPoint(current_segment))

        #para todos los sementos menos el último, añadimos el punto inicial del segmento, pero no el final
        if segment_index != len(segments)-1:
            
            for point_index in range(len(points_from_division)):
                
                if point_index != len(points_from_division)-1:
                    printing_points.append(rs.AddPoint(points_from_division[point_index])) 
            
        else:
            for point_index in range(len(points_from_division)):
                printing_points.append(rs.AddPoint(points_from_division[point_index])) 

    return printing_points

def add_z_hop(points, z_hop):
    
    if points: 
    
        z_hop_vector = (0,0,z_hop)
        end_point = points[-1]
    
        z_hop_point = rs.CopyObject( end_point, z_hop_vector)
        points.append(z_hop_point)
    
    return points
    
def get_wipe_point (segments, points, wipe_point_elevation):
    try:
        last_segment = segments[-1]
        last_point = points[-1]
        last_segment_unit_vector = rs.VectorUnitize(rs.VectorCreate( rs.CurveEndPoint(last_segment), rs.CurveStartPoint(last_segment)))
        wipe_vector = rs.VectorScale(last_segment_unit_vector, wipe_distance)
        #Añadimos elevacion al vector
        elevation_vector = (0,0,wipe_point_elevation)
        wipe_vector = rs.VectorAdd(wipe_vector, elevation_vector)
        wipe_point = rs.CopyObject(last_point, wipe_vector)

        return wipe_point
    except IndexError:
        return
        

def clean_path_end (points, nozzle_diameter):
    """
    Se trata de que los últimos milimetros del trazo se realicen sin extrusion en el caso de trazos cerrados. 
    En caso de trazos abiertos, se trata de añadir un pequeño recorrido horizontal al final sin extrusión para evitar llevarse el barro al hacer el z hop.
    """
    try:
        
        toolpath_polyline = rs.AddPolyline(points)
        if rs.IsCurveClosed (toolpath_polyline):
            is_closed = True
        else:
            is_closed = False
        segments = rs.ExplodeCurves(toolpath_polyline)
    except:
        return []
    if is_closed:
        #Añade un punto a una distancia de nozzle_dia/2 del punto final. en ese punto se dejará de extruir.
        #El corte de extrusión lo dará el valor de path_end_points_without_extrusion establecido al final del código
        
        try:
            last_segment = segments[-1]
            last_point = points[-1]
            end_circle = rs.AddCircle(last_point, nozzle_diameter/2)
            
            # Calcula la intersección entre el segmento final y el circulo
            intersection_list = rs.CurveCurveIntersection(last_segment, end_circle)
            if intersection_list:
                for tuple in intersection_list:
                    for element_index in tuple:         
                        stop_extrude_point = tuple[1]
            
            else:
                stop_extrude_point = None
                
            points.insert(-1, stop_extrude_point)
            #Además, sustituimos el ultimo punto del trazo (que era ya sin extrusion) por un wipe_point. Para que no se quede pegado el trazo a la boquilla al hacer z_hop
            wipe_point = get_wipe_point(segments, points, wipe_point_elevation)
            points[-1] = wipe_point
           
        except IndexError:
            pass

    elif not is_closed:
        #En este caso, añadimos un punto extra al final, haciendo un wipe, que siga la trayectria que traía
        wipe_point = get_wipe_point(segments, points, wipe_point_elevation)
        points.append(wipe_point)

    return points
# Main

filtered_points = filter_points (points, min_angle, resolution)
printing_points = add_extra_points_for_resolutiom (filtered_points, resolution)

path_end_points_without_extrusion = 0

if do_clean_path_end:
    printing_points = clean_path_end(printing_points, nozzle_diameter)
    path_end_points_without_extrusion += 1

if z_hop:
    printing_points = add_z_hop(printing_points, z_hop)
    path_end_points_without_extrusion += 1
# ---------- end python ----------
move_2 = Move(Geometry=item_6, Motion=Z_3)  # -> Geometry, Transform; disabled
merge_3 = Merge(Data1=python.printing_points)  # -> simplify(Result)
# F
panel_14 = Panel(merge_3)
viewer_2 = ParamViewer(python.printing_points)
points = ClusterOutput(merge_3)
panel_15 = Panel(python.printing_points)

# ==== cluster Cluster_2
f_factor = ClusterInput()
points_extruding = ClusterInput()
e_factor = ClusterInput()
points_no_extrussion = ClusterInput()
pt = Point(points_no_extrussion)
pt_2 = Point(points_extruding)

shift = ShiftList(List=pt_2, Shift=1, Wrap=True)
pt_3 = Point(pt_2)
lng = ListLength(List=pt_2)  # -> expr("x-1", Length)
dist = Distance(PointA=pt_2, PointB=shift)  # -> simplify(Distance)
cull_i = CullIndex(List=dist, Indices="-1", Wrap=True)  # -> simplify(List)
# extruding speed
neg = Negative(Value=e_factor)
ma = MassAddition(Input=cull_i)  # -> Result, PartialResults
multiplication = Multiplication(A=cull_i, B=neg)
num = Number(multiplication)

viewer = ParamViewer(cull_i)

# ----
# F
num_2 = Number(f_factor)

panel = Panel(num_2)
panel_2 = Panel(dist)
panel_3 = Panel("""-2
-1""")
panel_4 = Panel("""-2
-1""")
cull_i_2 = CullIndex(List=pt_2, Indices=panel_3, Wrap=True)  # -> simplify(List)
item = ListItem(List=pt_2, Index="0", Wrap=True)
item_2 = ListItem(List=pt_2, Index=panel_3, Wrap=True)
item_3 = ListItem(List=num, Index=panel_4, Wrap=True)
cull_i_3 = CullIndex(List=num, Indices=panel_4, Wrap=True)  # -> simplify(List)
merge = Merge(Data1=item, Data2=pt_2)
panel_5 = Panel(cull_i_3)
# Doubleclick Me!
panel_6 = Panel("3000")
# last 2 not extruding
expression = Expression(
    P=item_2,
    PrintSpeedF=num_2,
    d="0",
    Expression="Format(\"G1 X{0:0.00} Y{1:0.00} Z{2:0.00} F{3,0} E{4:0.00}\", P.x, P.y, P.z, PrintSpeedF, d)")
# duplicate first and not extrude
expression_2 = Expression(
    P=item,
    PrintSpeedF=panel_6,
    d="0",
    Expression="Format(\"G1 X{0:0.00} Y{1:0.00} Z{2:0.00} F{3,0} E{4:0.00}\", P.x, P.y, P.z, PrintSpeedF, d)")
# EXTRUDING
expression_3 = Expression(
    P=cull_i_2,
    PrintSpeedF=num_2,
    d=cull_i_3,
    Expression="Format(\"G1 X{0:0.00} Y{1:0.00} Z{2:0.00} F{3,0} E{4:0.00}\", P.x, P.y, P.z, PrintSpeedF, d)")
# NOT EXTRUDING
expression_4 = Expression(
    P=pt,
    PrintSpeedF=num_2,
    d=Slider(0, range=0..100),
    Expression="Format(\"G1 X{0:0.00} Y{1:0.00} Z{2:0.00} F{3,0} E{4:0.00}\", P.x, P.y, P.z, PrintSpeedF, d)")
merge_2 = Merge(Data1=expression_2, Data2=expression_3, Data3=expression, Data4=expression_4)  # -> flatten(Result)
g_code_output = Text(merge_2)
clean = CleanTree(RemoveNulls=True, RemoveInvalid=True, RemoveEmpty=False, Tree=g_code_output)
T = ClusterOutput(clean)
main_code = Panel(expression_2)

# ==== cluster Cluster_2_2
f_factor = ClusterInput()
points_extruding = ClusterInput()
e_factor = ClusterInput()
points_no_extrussion = ClusterInput()
pt = Point(points_no_extrussion)
pt_2 = Point(points_extruding)

shift = ShiftList(List=pt_2, Shift=1, Wrap=True)
pt_3 = Point(pt_2)
lng = ListLength(List=pt_2)  # -> expr("x-1", Length)
dist = Distance(PointA=pt_2, PointB=shift)  # -> simplify(Distance)
cull_i = CullIndex(List=dist, Indices="-1", Wrap=True)  # -> simplify(List)
# extruding speed
neg = Negative(Value=e_factor)
ma = MassAddition(Input=cull_i)  # -> Result, PartialResults
multiplication = Multiplication(A=cull_i, B=neg)
num = Number(multiplication)

viewer = ParamViewer(cull_i)

# ----
# F
num_2 = Number(f_factor)

panel = Panel(dist)
# Doubleclick Me!
panel_2 = Panel("0")
cull_i_2 = CullIndex(List=pt_2, Indices="-1", Wrap=True)  # -> simplify(List)
item = ListItem(List=pt_2, Index=panel_2, Wrap=True)
item_2 = ListItem(List=pt_2, Index="-1", Wrap=True)
item_3 = ListItem(List=num, Index="-1", Wrap=True)
cull_i_3 = CullIndex(List=num, Indices="-1", Wrap=True)  # -> simplify(List)
merge = Merge(Data1=item, Data2=pt_2)
panel_3 = Panel(item)
# last not extruding
expression = Expression(
    P=item_2,
    PrintSpeedF=num_2,
    d="0",
    Expression="Format(\"G1 X{0:0.00} Y{1:0.00} Z{2:0.00} F{3,0} E{4:0.00}\", P.x, P.y, P.z, PrintSpeedF, d)")
# duplicate first and not extrude
expression_2 = Expression(
    P=item,
    PrintSpeedF=num_2,
    d="0",
    Expression="Format(\"G1 X{0:0.00} Y{1:0.00} Z{2:0.00} F{3,0} E{4:0.00}\", P.x, P.y, P.z, PrintSpeedF, d)")
# EXTRUDING
expression_3 = Expression(
    P=cull_i_2,
    PrintSpeedF=num_2,
    d=cull_i_3,
    Expression="Format(\"G1 X{0:0.00} Y{1:0.00} Z{2:0.00} F{3,0} E{4:0.00}\", P.x, P.y, P.z, PrintSpeedF, d)")
# NOT EXTRUDING
expression_4 = Expression(
    P=pt,
    PrintSpeedF=num_2,
    d=Slider(0, range=0..100),
    Expression="Format(\"G1 X{0:0.00} Y{1:0.00} Z{2:0.00} F{3,0} E{4:0.00}\", P.x, P.y, P.z, PrintSpeedF, d)")
merge_2 = Merge(Data1=expression_2, Data4=expression_4)  # -> flatten(Result)
g_code_output = Text(merge_2)
clean = CleanTree(RemoveNulls=True, RemoveInvalid=True, RemoveEmpty=False, Tree=g_code_output)
T = ClusterOutput(clean)
main_code = Panel(expression_2)
