# Grasshopper definition trays.gh (Grasshopper 1.0.7)

ancho_bandeja = Slider(6, range=0..10)
altura_maceta = Slider(260, range=200..450)
diám_sup_maceta = Slider(290, range=0..290)
diám_inf_maceta = Slider(170, range=150..290)
ancho_asa = Slider(5, range=0..10)
altura_asa = Slider(35, range=0..50)
altura_sup_bandeja = Slider(175, range=0..350)
tolerancia = Slider(1, range=0..10)
bandejas_sólido_lateral = Slider(20, range=0..50)
orificios_bandejas = Slider(5, range=0..50)
interior_bandejas = Slider(3, range=0..50)
division = Division(A=ancho_bandeja, B=2)
subtraction = Subtraction(A=altura_sup_bandeja, B=ancho_bandeja)
subtraction_2 = Subtraction(A=diám_sup_maceta, B=diám_inf_maceta)
Z = UnitZ(Factor=altura_maceta)
division_2 = Division(A=subtraction_2, B=2)
cir = Circle(Plane=PlaneXY(0, 0, 0), Radius=expr("x/2", diám_sup_maceta))
subtraction_3 = Subtraction(A=altura_sup_bandeja, B=division)
cir_2 = Circle(Plane=PlaneXY(0, 0, 0), Radius=expr("x/2", diám_inf_maceta))
division_3 = Division(A=diám_inf_maceta, B=2)
division_4 = Division(A=division_2, B=altura_maceta)
multiplication = Multiplication(A=division_4, B=altura_sup_bandeja)
multiplication_2 = Multiplication(A=division_4, B=subtraction)
move = Move(Geometry=cir, Motion=Z)  # -> Geometry, Transform
division_5 = Division(A=diám_inf_maceta, B=2)
end = EndPoints(Curve=move.Geometry)  # -> Start, End
multiplication_3 = Multiplication(A=division_4, B=subtraction_3)
addition = Addition(A=division_3, B=multiplication)
end_2 = EndPoints(Curve=cir_2)  # -> Start, End
addition_2 = Addition(A=orificios_bandejas, B=interior_bandejas)
Z_2 = UnitZ(Factor=altura_sup_bandeja)
Z_3 = UnitZ(Factor=subtraction)
Z_4 = UnitZ(Factor=subtraction_3)
addition_3 = Addition(A=division_5, B=multiplication_2)
addition_4 = Addition(A=division_5, B=multiplication_3)
cir_3 = Circle(Plane=PlaneXY(0, 0, 0), Radius=addition)
ln = Line(StartPoint=end.Start, EndPoint=end_2.Start)
cir_4 = Circle(Plane=PlaneXY(0, 0, 0), Radius=addition_4)
move_2 = Move(Geometry=cir_4, Motion=Z_4)  # -> Geometry, Transform
move_3 = Move(Geometry=cir_3, Motion=Z_2)  # -> Geometry, Transform
cir_5 = Circle(Plane=PlaneXY(0, 0, 0), Radius=addition_3)
move_4 = Move(Geometry=cir_5, Motion=Z_3)  # -> Geometry, Transform
end_3 = EndPoints(Curve=move_3.Geometry)  # -> Start, End
end_4 = EndPoints(Curve=move_2.Geometry)  # -> Start, End
offset = OffsetCurve(Curve=move_3.Geometry, Distance=expr("-x", bandejas_sólido_lateral), Corners=1)
cpoly = ControlPolygon(Curve=offset)  # -> Polygon, Points
item = ListItem(List=cpoly.Points, Index=5, Wrap=True)
rectangle = Rectangle(Plane=item, XSize=addition_2, YSize=addition_2, Radius=0)  # -> Rectangle, Length
addition_5 = Addition(A=ancho_asa, B=tolerancia)
ln_2 = Line(StartPoint=end_3.Start, EndPoint=end_4.Start)
rectangle_2 = Rectangle(Plane=item, XSize=orificios_bandejas, YSize=orificios_bandejas, Radius=0)  # -> Rectangle, Length
offset_2 = OffsetCurve(Curve=move_2.Geometry, Distance=expr("-x/2", addition_5), Corners=1)
offset_3 = OffsetCurve(Curve=move_4.Geometry, Distance=expr("-x", addition_5), Corners=1)
arrrec = RectangularArray(Geometry=rectangle_2.Rectangle, Cell=rectangle.Rectangle, XCount=30, YCount=30)  # -> Geometry, Transform
end_5 = EndPoints(Curve=offset_2)  # -> flatten(Start), End
end_6 = EndPoints(Curve=offset_3)  # -> flatten(Start), End
Z_5 = UnitZ(Factor=expr("-x", ancho_bandeja))
ln_3 = Line(StartPoint=end_4.Start, EndPoint=end_5.End)
trim = TrimWithRegion(Curve=arrrec.Geometry, Region=offset)  # -> Inside, Outside
ln_4 = Line(StartPoint=end_5.End, EndPoint=end_6.Start)
boundary = BoundarySurfaces(Edges=offset_3)
join = JoinCurves(Curves=[ln_2, ln_3, ln_4], Preserve=False)
crv = Curve(flatten(trim.Inside))
cls = Closed(Curve=crv)  # -> Closed, Periodic
rulesrf = RuledSurface(CurveA=move_3.Geometry, CurveB=offset_3)  # -> flatten(Surface)
cull = CullPattern(List=crv, CullPattern=cls.Closed)
boundary_2 = BoundarySurfaces(Edges=move_3.Geometry)
nurbs = NurbsCurve(Vertices=[end_3.Start, end_4.Start, end_5.Start, end_6.Start], Degree=3, Periodic=False)  # -> Curve, Length, Domain
pline = PolyLine(Vertices=[end_3.Start, end_4.Start, end_5.Start, end_6.Start], Closed=False)
move_5 = Move(Geometry=cull, Motion=Z_5)  # -> Geometry, Transform
extr = Extrude(Base=cull, Direction=Z_5)
swp2 = Sweep2(Rail1=move_3.Geometry, Rail2=offset_3, Sections=nurbs.Curve, SameHeight=False)
sdiff = SolidDifference(BrepsA=boundary, BrepsB=move_5.Geometry)  # -> flatten(Result)
sdiff_2 = SolidDifference(BrepsA=boundary_2, BrepsB=cull)  # -> flatten(Result)
swp1 = Sweep1(Rail=move_3.Geometry, Sections=pline, Miter=1)  # -> flatten(Brep)
join_2 = BrepJoin(Breps=[sdiff_2, swp1, sdiff, extr])  # -> Breps, Closed
arc = Arc(Plane=move_3.Geometry, Radius=addition_3, Angle=Domain(0, 0.7853981634))  # -> Arc, Length
offset_4 = OffsetCurve(Curve=arc.Arc, Distance=expr("-x", ancho_asa), Corners=1)
end_7 = EndPoints(Curve=offset_4)  # -> Start, End
end_8 = EndPoints(Curve=arc.Arc)  # -> Start, End
ln_5 = Line(StartPoint=end_8.Start, EndPoint=end_7.Start)
ln_6 = Line(StartPoint=end_8.End, EndPoint=end_7.End)
Z_6 = UnitZ(Factor=altura_asa)
edgesrf = EdgeSurface(CurveA=arc.Arc, CurveB=ln_5, CurveC=offset_4, CurveD=ln_6)
extr_2 = Extrude(Base=edgesrf, Direction=Z_6)
debrep = DeconstructBrep(Brep=extr_2)  # -> Faces, Edges, Vertices
item_2 = ListItem(List=debrep.Faces, Index=2, Wrap=True)
edges = BrepEdges(Brep=item_2)  # -> Naked, Interior, NonManifold
join_3 = JoinCurves(Curves=edges.Naked, Preserve=False)  # -> graft(Curves)
offsets = OffsetOnSrf(Curve=edges.Naked, Distance=10, Surface=item_2)
